# Dynamo graph Exercise_Excel_to_Excel(Python_Time_Zone).dyn (Dynamo 3.0.1.7382)

string = StringInput("E:\FactoBIBuild Practice\Dynamo files\08 Cross_Country_Time_Zone\CCTime_Zone.xlsx")
string_2 = StringInput("E:\FactoBIBuild Practice\Dynamo files\08 Cross_Country_Time_Zone\Time_Zone_Output.xlsx")
python_script = Python(IN[0]=string, IN[1]=string_2)  # CPython3
# ---------- python_script.python (68 lines) ----------
# Load the Python Standard and DesignScript Libraries
import sys
import clr
import pandas as pd
from datetime import datetime
import pytz


# The inputs to this node will be stored as a list in the IN variables.
dataEnteringNode = IN

# Place your code below this line
Data = IN[0]

df = pd.read_excel(Data)

# Function to convert time to UTC
def convert_to_utc(time_str, country):
    try:
        local = pytz.timezone(country)
    except pytz.UnknownTimeZoneError:
        print(f"Unknown time zone: {country}")
        return datetime.now()  # Default to current datetime
    if isinstance(time_str, pd.Timestamp):
        time_str = str(time_str)  # Convert Timestamp to string
    naive = datetime.strptime(time_str, '%Y-%m-%d %H:%M:%S')  # Updated format string
    local_dt = local.localize(naive, is_dst=None)
    utc_dt = local_dt.astimezone(pytz.utc)
    return utc_dt
    

# Convert start and end time to UTC
df['StartTime_UTC'] = df.apply(lambda x: convert_to_utc(x['StartTime'], x['Country']).strftime('%Y-%m-%d %H:%M:%S'), axis=1)
df['EndTime_UTC'] = df.apply(lambda x: convert_to_utc(x['EndTime'], x['Country']).strftime('%Y-%m-%d %H:%M:%S'), axis=1)


# Function to get timezone offset
def get_timezone_offset(country, start_time):
    try:
        timezone = pytz.timezone(country)
        offset = timezone.utcoffset(start_time)
        offset_hours = offset.total_seconds() // 3600
        offset_minutes = (offset.total_seconds() % 3600) // 60
        offset_str = f"UTC {'+' if offset_hours >= 0 else '-'}{abs(offset_hours)}:{abs(offset_minutes)}"
        return offset_str
    except pytz.UnknownTimeZoneError:
        print(f"Unknown time zone: {country}")
        return 'Unknown'
     

# Add timezone offset to the Country column
df['Timezone_Offset'] = df.apply(lambda row: get_timezone_offset(row['Country'], row['StartTime']), axis=1)


# Remove the decimal part from timezone offset
df['Timezone_Offset'] = df['Timezone_Offset'].str.replace('.0', '')


df_final = df[['MeetingID', 'StartTime', 'EndTime', 'Country', 'StartTime_UTC', 'EndTime_UTC', 'Timezone_Offset']]


# Assign your output to the OUT variable.
output_path = IN[1]

# Save final_df2 to Excel
df_final.to_excel(output_path, index=False)

OUT = output_path
# ----------------------------------------
