# Dynamo graph Exercise_Excel_to_CSV(Python_DataType_Format).dyn (Dynamo 3.0.1.7382)

string = StringInput("E:\FactoBIBuild Practice\Dynamo files\09 DataType_Format\Excel_sales_w04_2.xlsx")
string_2 = StringInput("E:\FactoBIBuild Practice\Dynamo files\09 DataType_Format\DataType_Format_Output.xlsx")
python_script = Python(IN[0]=string, IN[1]=string_2)  # CPython3
# ---------- python_script.python (30 lines) ----------
# Load the Python Standard and DesignScript Libraries
import sys
import clr
import numpy as np
import pandas as pd

# The inputs to this node will be stored as a list in the IN variables.
dataEnteringNode = IN

# Place your code below this line
df = pd.read_excel(IN[0], usecols = ['Quantity', 'Discount'])


# Convert 'Quantity' column from object to int16
df['Quantity'] = df['Quantity'].astype(np.int16)

# Convert 'Discount' column from object to float32
df['Discount'] = df['Discount'].astype(np.float32)

# Displaying the resulting table with Missing Values handled
df_new = df[['Quantity', 'Discount']]


# Assign your output to the OUT variable.
output_path = IN[1]

# Save final_df2 to Excel
df_new.to_excel(output_path, index=False)

OUT = output_path
# ----------------------------------------
