# Dynamo graph Exercise_Excel_to_CSV(Python_Dates).dyn (Dynamo 3.0.1.7382)

string = StringInput("E:\FactoBIBuild Practice\Dynamo files\03 Dates\Excel_sales_w04_2.xlsx")
connectExcelDatabase = Factobi.Data.Database.ConnectExcelDatabase(excelFilePath=string)
string_2 = StringInput("sales_w04")
getData = Factobi.Data.Database.GetData(database=connectExcelDatabase, tableName=string_2)
string_3 = StringInput("Order_Date")
getColumnData = Factobi.Data.Table.GetColumnData(table=getData, columnName=string_3)
string_4 = StringInput("E:\FactoBIBuild Practice\Dynamo files\03 Dates\Dates_Output.csv")
python_script = Python(IN[0]=getColumnData, IN[1]=string_4)  # CPython3
# ---------- python_script.python (70 lines) ----------
# Load the Python Standard and DesignScript Libraries
import sys
import clr
import numpy as np
import pandas as pd
from dateutil import parser


# The inputs to this node will be stored as a list in the IN variables.
dataEnteringNode = IN

# Extract the list from the input
Order_Date = IN[0]

# Assuming 'order_date_column' is your data, create a DataFrame
df = pd.DataFrame({'Order_Date': Order_Date})

# Function to convert Excel date serial numbers to datetime
def convert_excel_date(serial_number):
    if pd.notnull(serial_number):
        try:
            return pd.to_datetime('1899-12-30') + pd.to_timedelta(serial_number, 'D')
        except ValueError:
            return pd.NaT
    else:
        return pd.NaT

# Function to parse various date formats
def parse_date(date_str):
    try:
        return parser.parse(str(date_str), fuzzy=True)
    except parser.ParserError:
        return pd.NaT

# Assuming 'Order_Date' is the column with different date formats
df['Order_DateN'] = df['Order_Date'].apply(lambda x: convert_excel_date(x) if isinstance(x, (int, float)) else parse_date(x))

# Extracting date-related information
df['Date'] = pd.to_datetime(df['Order_DateN'], errors='coerce', format='%m/%d/%Y')
df['Year'] = df['Order_DateN'].dt.year

# Handle non-finite values in Quarter
df['Quarter'] = df['Order_DateN'].dt.quarter
df['Quarter'] = df['Quarter'].replace([np.inf, -np.inf, np.nan], 0).astype(int)

df['Quarter_Name'] = df['Order_DateN'].dt.to_period('Q').astype(str).str.replace(r'\d+Q', 'Q')
# Handle non-finite values in Month
df['Month'] = df['Order_DateN'].dt.month.replace([np.inf, -np.inf, np.nan], 0).astype(int)

df['Month_Name'] = df['Order_DateN'].dt.strftime('%B')
df['Month_Name_Short'] = df['Order_DateN'].dt.strftime('%b')  # Short month names
df['Week_Number'] = df['Order_DateN'].dt.isocalendar().week
# Handle non-finite values in Weekday
df['Weekday'] = (df['Order_DateN'].dt.weekday + 1).replace([np.inf, -np.inf, np.nan], 0).astype(int)  # Adding 1 to make Monday = 1, Sunday = 7

df['Weekday_Name'] = df['Order_DateN'].dt.strftime('%A')
df['Weekday_Name_Short'] = df['Order_DateN'].dt.strftime('%a')  # Short weekday names

# Displaying the resulting table
df_dates_info = df[['Order_Date', 'Order_DateN', 'Date', 'Year', 'Quarter', 'Quarter_Name', 'Month', 'Month_Name', 'Month_Name_Short', 'Week_Number', 'Weekday', 'Weekday_Name', 'Weekday_Name_Short']]


# Specify the output path
output_path = IN[1]

# Save final_df2 to Excel
df_dates_info.to_csv(output_path, index=False)

# Assign the output path to the OUT variable
OUT = output_path
# ----------------------------------------
watch = Watch(getData)
watch_2 = Watch(getColumnData)
