# Dynamo graph Exercise_Excel_to_CSV(Python_Duplicates).dyn (Dynamo 3.0.1.7382)

string = StringInput("E:\FactoBIBuild Practice\Dynamo files\05 Duplicates\Duplicates.xlsx")
string_2 = StringInput("E:\FactoBIBuild Practice\Dynamo files\05 Duplicates\Duplicates_Output.csv")
python_script = Python(IN[0]=string, IN[1]=string_2)  # CPython3
# ---------- python_script.python (33 lines) ----------
# Load the Python Standard and DesignScript Libraries
import sys
import clr
import pandas as pd

# The inputs to this node will be stored as a list in the IN variables.
dataEnteringNode = IN

# Place your code below this line

df = pd.read_excel(IN[0])
# Add a new column to flag duplicates
df['IsDuplicate'] = df.duplicated(subset=['Name', 'City'], keep=False)

# Filter the DataFrame to include only rows where 'IsDuplicate' is True
df = df[df['IsDuplicate']]

# Sort the DataFrame by 'Name' and 'City'
df = df.sort_values(by=['Name', 'City'])

# Displaying the resulting table with outliers handled
df_new = df[['CustomerID', 'Name', 'City', 'IsDuplicate']]



# Specify the output path
output_path = IN[1]

# Save final_df2 to Excel
df_new.to_csv(output_path, index=False)

# Assign the output path to the OUT variable
OUT = output_path
# ----------------------------------------
