# Dynamo graph Exercise_Excel_to_Excel(Python_InconsistantEmails).dyn (Dynamo 3.0.1.7382)

string = StringInput("E:\FactoBIBuild Practice\Dynamo files\10 Inconsistent Emails\Inconsistent Emails.xlsx")
string_2 = StringInput("E:\FactoBIBuild Practice\Dynamo files\10 Inconsistent Emails\Inconsistent Emails_Output.xlsx")
python_script = Python(IN[0]=string, IN[1]=string_2)  # CPython3
# ---------- python_script.python (43 lines) ----------
# Load the Python Standard and DesignScript Libraries
import sys
import clr
import pandas as pd

# The inputs to this node will be stored as a list in the IN variables.
dataEnteringNode = IN

# Place your code below this line

Data = IN[0]

df = pd.read_excel(Data)

# Function to process email anomalies and create flags
def process_email(email):
    flag = ''
    if not email:
        flag = 'Not_an_email'
    elif '@' not in email:
        flag = 'DomainName_missing'
    elif '.' not in email.split('@')[-1] or '.' == email.split('@')[-1]:
        flag = 'Incomplete_DomainName'
    elif not email.split('@')[0]:
        flag = 'Incomplete_Username'
    elif not email.split('@')[-1].split('.')[0]:
        flag = 'Incomplete_DomainName'
    return flag

# Applying the function to create flags
df['Flag'] = df['Email'].apply(process_email)





# Assign your output to the OUT variable.
output_path = IN[1]

# Save final_df2 to Excel
df.to_excel(output_path, index=False)

OUT = output_path
# ----------------------------------------
