# Dynamo graph Exercise_Excel_to_Excel(Python_Join).dyn "Exercise_Excel_to_SQL(Python_Join)" (Dynamo 3.0.1.7382)

string = StringInput("E:\FactoBIBuild Practice\Dynamo files\01 Join\Join_Output.csv")
string_2 = StringInput("E:\My PowerBI Tools + Datasets + Projects\02 Datasets\DeepNeuron\Consumers_data.xlsx")
getOleDbProviders = Factobi.Data.Database.GetOleDbProviders()
code_block = CodeBlock { 4; }
getItemAtIndex = List.GetItemAtIndex(list=getOleDbProviders, index=code_block)
connectExcelDatabase = Factobi.Data.Database.ConnectExcelDatabase(excelFilePath=string_2, oleDbProvider=getItemAtIndex)
string_3 = StringInput("Consumers_data")
getData = Factobi.Data.Database.GetData(database=connectExcelDatabase, tableName=string_3)
code_block_2 = CodeBlock { ["City", "State-Province"]; }
getColumnData = Factobi.Data.Table.GetColumnData(table=getData, columnName=code_block_2)
code_block_3 = CodeBlock { 0; }
getItemAtIndex_2 = List.GetItemAtIndex(list=getColumnData, index=code_block_3)
code_block_4 = CodeBlock { 1; }
getItemAtIndex_3 = List.GetItemAtIndex(list=getColumnData, index=code_block_4)
python_script = Python(IN[0]=getItemAtIndex_2, IN[1]=getItemAtIndex_3)  # CPython3
# ---------- python_script.python (27 lines) ----------
# Load the Python Standard and DesignScript Libraries
import sys
import clr
import pandas as pd

# Add references
clr.AddReference('ProtoGeometry')
from Autodesk.DesignScript.Geometry import *

# The inputs to this node will be stored as a list in the IN variables.
dataEnteringNode = IN

# Extract the columns from the input
column1 = IN[0]
column2 = IN[1]

# Create a DataFrame
df = pd.DataFrame({ 'Column1': column1, 'Column2': column2 })

# Apply lambda function to concatenate columns with a hyphen
df['Combined_Column'] = df.apply(lambda row: '-'.join(map(str, [row['Column1'], row['Column2']])), axis=1)

# Extract the modified column
combined_column = df['Combined_Column'].tolist()

# Assign the modified column to the OUT variable.
OUT = combined_column
# ----------------------------------------
watch = Watch(python_script)
exportCSV = Data.ExportCSV(filePath=string, data=watch)
