# Dynamo graph Exercise_Excel_to_Excel(Python_Lat_Long_Mismatch).dyn (Dynamo 3.0.1.7382)

string = StringInput("E:\FactoBIBuild Practice\Dynamo files\12 Lattitude Longitude MisMatch\Lat_Long_Data.xlsx")
string_2 = StringInput("E:\FactoBIBuild Practice\Dynamo files\12 Lattitude Longitude MisMatch\Lat_Long_Output.xlsx")
python_script = Python(IN[0]=string, IN[1]=string_2)  # CPython3
# ---------- python_script.python (60 lines) ----------
# Load the Python Standard and DesignScript Libraries
import sys
import clr
import pandas as pd

# The inputs to this node will be stored as a list in the IN variables.
dataEnteringNode = IN

# Place your code below this line

Data = IN[0]

data = pd.read_excel(Data)

# Function to fix the direction anomaly and create a new column
def fix_direction(row):
    new_lat = row['Latitude']
    new_long = row['Longitude']
    
    # Check if latitude and longitude need to be flipped
    if row['Latitude'][-1] not in ('N', 'S') and row['Longitude'][-1] not in ('E', 'W'):
        new_lat = row['Longitude']
        new_long = row['Latitude']
        fix_action = 'Direction exchanged to fix the anomaly'
    else:
        fix_action = ''
    
    return pd.Series([new_lat, new_long, fix_action], index=['Latitude', 'Longitude', 'Fix Action'])
    

# Apply the function to each row
data[['Latitude', 'Longitude', 'Fix Action']] = data.apply(fix_direction, axis=1)


final_df = data[['DeliveryID', 'Location', 'Latitude', 'Longitude', 'Fix Action']]



# Assign your output to the OUT variable.
output_path = IN[1]

# Save final_df to Excel
final_df.to_excel(output_path, index=False)

OUT = output_path













# Assign your output to the OUT variable.
OUT = 0
# ----------------------------------------
