# Dynamo graph Exercise_Excel_to_CSV(Python_Missing_Values).dyn (Dynamo 3.0.1.7382)

getOleDbProviders = Factobi.Data.Database.GetOleDbProviders()
code_block = CodeBlock { 4; }
getItemAtIndex = List.GetItemAtIndex(list=getOleDbProviders, index=code_block)
string = StringInput("E:\FactoBIBuild Practice\Dynamo files\07 Missing_Values\Excel_sales_w04_2.xlsx")
connectExcelDatabase = Factobi.Data.Database.ConnectExcelDatabase(excelFilePath=string)
string_2 = StringInput("sales_w04")
getData = Factobi.Data.Database.GetData(database=connectExcelDatabase, tableName=string_2)
string_3 = StringInput("Sales")
getColumnData = Factobi.Data.Table.GetColumnData(table=getData, columnName=string_3)
watch = Watch(getColumnData)
string_4 = StringInput("E:\FactoBIBuild Practice\Dynamo files\07 Missing_Values\Missing_Values_Output.csv")
python_script = Python(IN[0]=getColumnData)  # CPython3
# ---------- python_script.python (26 lines) ----------
# Load the Python Standard and DesignScript Libraries
import sys
import clr
import numpy as np
import pandas as pd

# Add references
clr.AddReference('ProtoGeometry')
from Autodesk.DesignScript.Geometry import *

# The inputs to this node will be stored as a list in the IN variables.
dataEnteringNode = IN

# Assuming 'IN[0]' is your 'Profit' column, create a DataFrame
df = pd.DataFrame({'Sales': IN[0]})

# Fill missing values in the 'Sales' column with 0
df['Sales'] = df['Sales'].fillna(0)

# Displaying the resulting table with Missing Values handled
df_new = df[['Sales']]

# Convert the DataFrame to a list of dictionaries
result_list = df_new.values.tolist()

OUT = result_list
# ----------------------------------------
watch_2 = Watch(python_script)
exportCSV = Data.ExportCSV(filePath=string_4, data=watch_2)
