# Dynamo graph Exercise_Excel_to_Excel(Python_ProductClassification).dyn (Dynamo 3.0.1.7382)

string = StringInput("E:\FactoBIBuild Practice\Dynamo files\Z Product_Classification\S_Data.xlsx")
string_2 = StringInput("E:\FactoBIBuild Practice\Dynamo files\Z Product_Classification\T_Data.xlsx")
string_3 = StringInput("E:\FactoBIBuild Practice\Dynamo files\Z Product_Classification\Product_Classification_Output.xlsx")
python_script = Python(IN[0]=string, IN[1]=string_2, IN[2]=string_3)  # CPython3
# ---------- python_script.python (61 lines) ----------
# Load the Python Standard and DesignScript Libraries
import sys
import clr
import pandas as pd


# The inputs to this node will be stored as a list in the IN variables.
dataEnteringNode = IN

# Place your code below this line

Data1 = IN[0]
Data2 = IN[1]

# Load data from Excel files
file1 = pd.read_excel(Data1)
file2 = pd.read_excel(Data2)


# Task 1: Inner join the two dataframes
joined_table = pd.merge(file2, file1, how="left", left_on="T_Commodity Title", right_on="S_Commodity Title")


# Task 2: Create observations column
def classify(row):
    if pd.isna(row['S_Commodity Title']):
        return "Commodity Title not in Standard Table"
    elif pd.isna(row['T_Commodity Code']):
        return "Unclassified"
    elif row['S_Commodity Code'] != row['T_Commodity Code']:
        return "Misclassified"
    else:
        return "Rightly Classified"

joined_table['Observations'] = joined_table.apply(classify, axis=1)


# Task 3: Create suggestions column
def suggest(row):
    if pd.isna(row['T_Commodity Code']):
        return row['S_Commodity Code']
    elif row['S_Commodity Code'] != row['T_Commodity Code']:
        return row['S_Commodity Code']
    else:
        return row['T_Commodity Code']

joined_table['Suggestions'] = joined_table.apply(suggest, axis=1)


# Filter out rows that are rightly classified
filtered_table = joined_table[joined_table['Observations'] != 'Rightly Classified']



# Assign your output to the OUT variable.
output_path = IN[2]

# Save final_df to Excel
filtered_table.to_excel(output_path, index=False)

OUT = output_path
# ----------------------------------------
