# Dynamo graph 02 Exercise_Excel_to_CSV(Python_Split).dyn "02 Exercise_Excel_to_Excel(Python_Split)" (Dynamo 3.0.1.7382)

string = StringInput("E:\FactoBIBuild Practice\Dynamo files\02 Split\Excel_sales_w04_2.xlsx")
getOleDbProviders = Factobi.Data.Database.GetOleDbProviders()
code_block = CodeBlock { 4; }
getItemAtIndex = List.GetItemAtIndex(list=getOleDbProviders, index=code_block)
connectExcelDatabase = Factobi.Data.Database.ConnectExcelDatabase(excelFilePath=string, oleDbProvider=getItemAtIndex)
string_2 = StringInput("sales_w04")
getData = Factobi.Data.Database.GetData(database=connectExcelDatabase, tableName=string_2)
string_3 = StringInput("Order_ID")
getColumnData = Factobi.Data.Table.GetColumnData(table=getData, columnName=string_3)
watch = Watch(getColumnData)
string_4 = StringInput("E:\FactoBIBuild Practice\Dynamo files\02 Split\Split_Output.csv")
python_script = Python(IN[0]=getColumnData)  # CPython3
# ---------- python_script.python (34 lines) ----------
# Load the Python Standard and DesignScript Libraries
import sys
import clr
import numpy as np
import pandas as pd

# Add references
clr.AddReference('ProtoGeometry')
from Autodesk.DesignScript.Geometry import *

# The inputs to this node will be stored as a list in the IN variables.
dataEnteringNode = IN

# Extract the list from the input
combined_column = IN[0]

# Create a DataFrame from the list
df = pd.DataFrame({'Combined_Column': combined_column})

# Specify the separator(s)
separators = '|'.join(['-', ',', ';'])  # Combine separators into a regex pattern
# Add more separators as needed

# Split the combined column based on the specified separators
df_split = df['Combined_Column'].str.split(separators, expand=True)

# Rename the columns if needed
df_split.columns = [f'Column{i}' for i in range(1, df_split.shape[1] + 1)]

# Transpose the DataFrame and convert to a list of lists
split_columns = df_split.T.values.tolist()

# Assign the split columns to the OUT variables.
OUT = split_columns
# ----------------------------------------
watch_2 = Watch(python_script)
exportCSV = Data.ExportCSV(filePath=string_4, data=watch_2)
