# Dynamo graph Exercise_Excel_to_CSV(Python_Trim).dyn "Exercise_Excel_to_CSV(Python_Outlier_Single_Col)" (Dynamo 3.0.1.7382)

string = StringInput("E:\FactoBIBuild Practice\Dynamo files\04 Outlier_Single_Col\Excel_sales_w04_2.xlsx")
getOleDbProviders = Factobi.Data.Database.GetOleDbProviders()
code_block = CodeBlock { 4; }
getItemAtIndex = List.GetItemAtIndex(list=getOleDbProviders, index=code_block)
connectExcelDatabase = Factobi.Data.Database.ConnectExcelDatabase(excelFilePath=string, oleDbProvider=getItemAtIndex)
string_2 = StringInput("sales_w04")
getData = Factobi.Data.Database.GetData(database=connectExcelDatabase, tableName=string_2)
string_3 = StringInput("Profit")
getColumnData = Factobi.Data.Table.GetColumnData(table=getData, columnName=string_3)
watch = Watch(getColumnData)
string_4 = StringInput("E:\FactoBIBuild Practice\Dynamo files\04 Outlier_Single_Col\Outlier_Single_Col_Output.csv")
python_script = Python(IN[0]=getColumnData)  # CPython3
# ---------- python_script.python (43 lines) ----------
# Load the Python Standard and DesignScript Libraries
import sys
import clr
import numpy as np
import pandas as pd

# Add references
clr.AddReference('ProtoGeometry')
from Autodesk.DesignScript.Geometry import *

# The inputs to this node will be stored as a list in the IN variables.
dataEnteringNode = IN

# Assuming 'IN[0]' is your 'Profit' column, create a DataFrame
df = pd.DataFrame({'Profit': IN[0]})

# Function to handle outliers using IQR
def handle_outliers_iqr(dataframe, column):
    Q1 = dataframe[column].quantile(0.25)
    Q3 = dataframe[column].quantile(0.75)
    IQR = Q3 - Q1

    # Define lower and upper bounds to identify outliers
    lower_bound = Q1 - 1.5 * IQR
    upper_bound = Q3 + 1.5 * IQR

    # Round lower and upper bounds to 2 decimal places
    lower_bound_rounded = round(lower_bound, 4)
    upper_bound_rounded = round(upper_bound, 4)
    
    # Identify and handle outliers by capping them at the upper and lower bounds
    dataframe['Profit_Outlier'] = dataframe[column].apply(lambda x: f'More than Upper Bound {upper_bound_rounded}' if x > upper_bound else f'Less Than Lower Bound {lower_bound_rounded}' if x < lower_bound else x)

# Apply the IQR method to handle outliers in the 'Profit' column
handle_outliers_iqr(df, 'Profit')

# Displaying the resulting table with outliers handled
df_new = df[['Profit', 'Profit_Outlier']]

# Convert the DataFrame to a list of dictionaries
result_list = df_new.values.tolist()

OUT = result_list
# ----------------------------------------
watch_2 = Watch(python_script)
exportCSV = Data.ExportCSV(filePath=string_4, data=watch_2)
