# Dynamo graph Exercise_Excel_to_Excel(Python_UnitConversion).dyn (Dynamo 3.0.1.7382)

string = StringInput("E:\FactoBIBuild Practice\Dynamo files\11 Unit Conversion\Conversion_Data.xlsx")
string_2 = StringInput("E:\FactoBIBuild Practice\Dynamo files\11 Unit Conversion\Unit_Conversion.xlsx")
string_3 = StringInput("E:\FactoBIBuild Practice\Dynamo files\11 Unit Conversion\Conversion_Output.xlsx")
python_script = Python(IN[0]=string, IN[1]=string_2, IN[2]=string_3)  # CPython3
# ---------- python_script.python (44 lines) ----------
# Load the Python Standard and DesignScript Libraries
import sys
import clr
import pandas as pd

# The inputs to this node will be stored as a list in the IN variables.
dataEnteringNode = IN

# Place your code below this line
Data1 = IN[0]
df_data = pd.read_excel(Data1)

Data2 = IN[1]
df_unit_conversion = pd.read_excel(Data2)

# Function to split quantity and unit from weight string
def split_weight(weight_str):
    quantity, unit = weight_str.split(' ')
    return float(quantity), unit
    

# Apply split_weight function to df_data table
df_data[['Quantity', 'Unit']] = df_data['Weight'].apply(lambda x: pd.Series(split_weight(x)))


# Merge df_data with unit_conversion table
merged_table = pd.merge(df_data, df_unit_conversion, left_on='Unit', right_on='To', how='left')


# Calculate weights in kilograms
merged_table['Weight_in_kg'] = merged_table['Quantity'] / merged_table['Conversion Factor']


final_df = merged_table[['ProductID', 'Name', 'Weight', 'Weight_in_kg']]



# Assign your output to the OUT variable.
output_path = IN[2]

# Save final_df to Excel
final_df.to_excel(output_path, index=False)

OUT = output_path
# ----------------------------------------
